# Grasshopper definition CgalTest.gh (Grasshopper 1.0.7)

rel = GhPythonScript(path="config.json")  # -> a
# ---------- rel: Python ----------
ghenv.Component.NickName = "Rel"

import rhinoscriptsyntax as rs

dir = rs.DocumentPath()
a = dir + "spec\\" + path
# ---------- end rel ----------
file = ReadFile(File=rel, PerLineParse=False)
dll = ImportDll(asm="CgalUtilWrapper.dll", config=file)  # -> dll
# ---------- dll: Python ----------
ghenv.Component.Name = "Import Dll"
ghenv.Component.NickName = "Dll"

import rhinoscriptsyntax as rs
import System.IO as io
import clr, json

cwd = io.Path.GetDirectoryName(ghenv.Component.OnPingDocument().FilePath) + "/spec/"
io.Directory.SetCurrentDirectory(cwd)

thisDir = rs.DocumentPath();
cfg = json.loads(config)
binDir = io.Directory.GetParent(thisDir).Parent.Parent.FullName + "\\x64\\" + cfg["build"] + "\\"
asmPath = binDir + asm
dll = asmPath

clr.AddReferenceToFileAndPath(asmPath)
# ---------- end dll ----------

pt = Point([Point(71.00629513, 31.14601945, 0), Point(-45.46030288, -22.92775819, 0), Point(42.23347137, 52.80156046, 0)])
pt_2 = Point([Point(77.17964876, -5.811189158, 0), Point(73.7683213, -29.23563767, 0), Point(40.79215592, -36.74055807, 0), Point(2.720819515, -5.249792425, 0), Point(30.4509619, 7.575398427, 0)])
pt_3 = Point([Point(57.62802464, -96.5009216, 0), Point(108.7557906, -79.63678936, 0), Point(87.0733349, -56.08054115, 0), Point(-31.64105221, -54.1675274, 0)])
pt_4 = Point([Point(54.40490909, 85.79482679, 0), Point(-2.66676122, 65.30286978, 0), Point(-35.40726939, 45.3550105, 0), Point(-83.85608051, -42.6009072, 0), Point(-7.516387235, -80.60551641, 0), Point(-19.08300743, -128.1938966, 0), Point(170.9674266, -107.1648866, 0), Point(128.7966889, 5.404275297, 0), Point(91.04208104, 68.93855822, 0)])
pline = PolyLine(Vertices=pt, Closed=True)
pline_2 = PolyLine(Vertices=pt_2, Closed=True)
pline_3 = PolyLine(Vertices=pt_3, Closed=True)
pline_4 = PolyLine(Vertices=pt_4, Closed=True)
merge = Merge(Data1=pline_3, Data2=pline_2, Data3=pline)  # -> flatten(Result)

brep = Brep(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)
mesh = MeshBrep(
    Brep=brep,
    Settings={GridMaxCount=0, GridMinCount=16, JaggedSeams=False, MaxEdgeLength=0, MinEdgeLength=0.0001, MinTolerance=0, Refine=True, RefineAngle=0, RelativeTolerance=0.65, SimplePlanes=True, Tolerance=0})

pt_5 = Point([Point(-376.9918669, 164.3168266, 0), Point(-598.6931342, 23.44414632, 0), Point(-480.914336, -124.3566985, 0), Point(-462.4392303, 18.82536992, 0), Point(-300.7820563, -85.09709913, 0), Point(-393.1575843, -45.83749971, 0), Point(-291.5445035, 58.08496933, 0)])
pt_6 = Point([Point(-81.73192766, -243.2492432, 0), Point(45.54399863, -290.2201208, 0), Point(48.57437783, -432.647943, 0), Point(74.332601, -365.9796007, 0), Point(103.1212034, -511.4378022, 0), Point(-127.1876156, -493.255527, 0)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])

c_script = CSharpScript(path="spec/ConvexHull(Points).py", refresh=Button())  # -> out, A; inputs path: String, refresh: Boolean
# ---------- c_script: C# usings ----------
using System.IO;
# ---------- c_script: C# ----------
    string thisDir = Path.GetDirectoryName(this.Component.OnPingDocument().FilePath);
        string file = File.ReadAllText(thisDir + @"\" + path);
    A = file;
# ---------- end c_script ----------
convexhull_points = Instance(Code=c_script.A, Dll=dll, Points=pt_6)  # -> Out, Hull

c_script_2 = CSharpScript(path="spec/OptimalBoundingBox.py", refresh=Button())  # -> out, A; inputs path: String, refresh: Boolean; same code as c_script
optimalboundingbox = Instance(Code=c_script_2.A, Dll=dll, Mesh=mesh)  # -> Out, Obb

c_script_3 = CSharpScript(path="spec/ConvexHull.py", refresh=Button())  # -> out, A; inputs path: String, refresh: Boolean; same code as c_script
convexhull = Instance(Code=c_script_3.A, Dll=dll, Mesh=mesh)  # -> Out, Hull

c_script_4 = CSharpScript(path="spec/BoundingCircle.py", refresh=Button())  # -> out, A; inputs path: String, refresh: Boolean; same code as c_script
boundingcircle = Instance(Code=c_script_4.A, Dll=dll, Points=pt_5)  # -> Out, A, B, R

c_script_5 = CSharpScript(path="spec/StraightSkeleton.py", refresh=Button())  # -> out, A; inputs path: String, refresh: Boolean; same code as c_script
straightskeleton = Instance(Code=c_script_5.A, Dll=dll, Outer=pline_4, Inner=merge)  # -> Out, StraightSkeleton, Spokes, Envelope
panel = Panel(straightskeleton.Out)

pt_7 = ConstructPoint(XCoordinate=boundingcircle.A, YCoordinate=boundingcircle.B, ZCoordinate=0)
cir = Circle(Plane=pt_7, Radius=boundingcircle.R)
preview = CustomPreview(Geometry=cir, Material=ColourSwatch(SwatchColor=RGB(21, 255, 0)))

medges = MeshEdges(Mesh=convexhull_points.Hull)  # -> NakedEdges, InteriorEdges, NonManifoldEdges
merge_2 = Merge(Data1=medges.NakedEdges, Data2=medges.InteriorEdges, Data3=medges.NonManifoldEdges)
preview_2 = CustomPreview(Geometry=convexhull_points.Hull, Material=ColourSwatch(SwatchColor=RGBA(21, 255, 0, 106)))

medges_2 = MeshEdges(Mesh=convexhull.Hull)  # -> NakedEdges, InteriorEdges, NonManifoldEdges
wires = BrepWireframe(Brep=optimalboundingbox.Obb, Density=-1)
merge_3 = Merge(Data1=medges_2.NakedEdges, Data2=medges_2.InteriorEdges, Data3=medges_2.NonManifoldEdges)
preview_3 = CustomPreview(Geometry=mesh, Material=ColourSwatch(SwatchColor=RGBA(91, 143, 136, 106)))
preview_4 = CustomPreview(Geometry=merge_3, Material=ColourSwatch(SwatchColor=RGB(21, 255, 0)))
preview_5 = CustomPreview(Geometry=wires, Material=ColourSwatch(SwatchColor=RGB(255, 0, 0)))

preview_6 = CustomPreview(Geometry=merge_2, Material=ColourSwatch(SwatchColor=RGB(21, 255, 0)))

preview_7 = CustomPreview(Geometry=[pline_4, merge], Material=ColourSwatch(SwatchColor=RGB(251, 255, 0)))
preview_8 = CustomPreview(Geometry=straightskeleton.StraightSkeleton, Material=ColourSwatch(SwatchColor=RGB(76, 176, 0)))
preview_9 = CustomPreview(Geometry=straightskeleton.Envelope, Material=ColourSwatch(SwatchColor=RGB(143, 127, 127)))
preview_10 = CustomPreview(Geometry=straightskeleton.Spokes, Material=ColourSwatch(SwatchColor=RGB(70, 112, 38)))
