# Grasshopper definition CgalTest.gh (Grasshopper 1.0.7)

dll = ImportDll(asm="CgalUtilWrapper.dll")  # -> dll
# ---------- dll: Python ----------
ghenv.Component.Name = "Import Dll"
ghenv.Component.NickName = "Dll"

import rhinoscriptsyntax as rs
import System.IO as io
import clr

cwd = io.Path.GetDirectoryName(ghenv.Component.OnPingDocument().FilePath) + "/spec/"
io.Directory.SetCurrentDirectory(cwd)

thisDir = rs.DocumentPath();
binDir = io.Directory.GetParent(thisDir).Parent.FullName + "\\x64\\Debug\\"
asmPath = binDir + asm
dll = asmPath

clr.AddReferenceToFileAndPath(asmPath)
# ---------- end dll ----------
pt = Point([Point(-22.5550093, 8.399851186, 0), Point(-14.31567612, 8.399851186, 0), Point(-7.875667903, -2.660967389, 0), Point(-17.46859038, 2.638174929, 0), Point(-23.60261882, -1.734457775, 0)])
pt_2 = Point([Point(10.03504381, 22.14097976, 0), Point(28.73406013, 25.95988025, 0), Point(38.01243837, 2.363923694, 0), Point(7.338680421, -0.6520408068, 0)])
pt_3 = Point([Point(31.88414788, 44.88199575, 0), Point(0.4890359235, 44.88199575, 0), Point(-18.01755639, 24.0620794, 0), Point(-47.76029403, 13.48688379, 0), Point(-21.65277988, -32.44912212, 0), Point(13.38279291, -26.95612308, 0), Point(38.82411999, -26.83104945, 0), Point(59.31356148, 12.82593407, 0), Point(52.37358936, 35.95917446, 0)])
pline = PolyLine(Vertices=pt, Closed=True)
pline_2 = PolyLine(Vertices=pt_2, Closed=True)
pline_3 = PolyLine(Vertices=pt_3, Closed=True)
merge = Merge(Data1=pline_2, Data2=pline)  # -> flatten(Result)
c_script = CSharpScript(path="spec/StraightSkeleton.py", refresh=Button())  # -> out, A; inputs path: String, refresh: Boolean
# ---------- c_script: C# usings ----------
using System.IO;
# ---------- c_script: C# ----------
    string thisDir = Path.GetDirectoryName(this.Component.OnPingDocument().FilePath);
        string file = File.ReadAllText(thisDir + @"\" + path);
    A = file;
# ---------- end c_script ----------
straightskeletontest = Instance(Code=c_script.A, Dll=dll, Outer=pline_3, Inner=merge)  # -> Out, StraightSkeleton
crv = Curve(straightskeletontest.StraightSkeleton)
merge_2 = Merge(Data1=pline_3, Data2=merge)  # -> flatten(Result)
divlength = DivideLength(Curve=crv, Length=Slider(3, range=0.1..100))  # -> flatten(Points), Tangents, Parameters
python = GhPythonScript(point=divlength.Points, curves=merge_2)  # -> out, radius; inputs point: Point3d, curves: list of Curve
# ---------- python: Python ----------
import Rhino.Geometry as rg

radius = float.MaxValue

for crv in curves:
    ok, t = crv.ClosestPoint(point)
    if not ok: continue
    dist = point.DistanceTo(crv.PointAt(t))
    if dist < radius:
        radius = dist
# ---------- end python ----------
cir = Circle(Plane=divlength.Points, Radius=python.radius)
